# Grasshopper definition main.gh (Grasshopper 1.0.7)
# plug-ins: Human UI, DynaModel_v2

thickness = Slider(1, range=0.005..2)
size = Slider(1, range=0.005..2)
panel = Panel("Step 1: Create a cutter to cut the model into two part: main model and end effector")
separator = CreateSeparator(Thickness=0.5, Horizontal=True, Color=RGB(0, 0, 0))
tb = CreateTextBlock(Text="Step 2: Scale the cutter", TextSize=12, Justification=0)
slider = CreateSlider(Slider=size, ShowBounds=False, ShowTicks=False, ShowTooltip=False, ShowValLabel=True, showLabel=True)
separator_2 = CreateSeparator(Thickness=0.5, Horizontal=True, Color=RGB(0, 0, 0))
slider_2 = CreateSlider(Slider=thickness, ShowBounds=False, ShowTicks=False, ShowTooltip=False, ShowValLabel=True, showLabel=True)
button = CreateButton(ButtonName="Clear", ButtonStyle=0)
button_2 = CreateButton(ButtonName="Choose", ButtonStyle=0)
tb_2 = CreateTextBlock(Text="Step 3: Choose your end effector", TextSize=12, Justification=0)
tb_3 = CreateTextBlock(Text=panel, TextSize=12, Justification=0)
button_3 = CreateButton(ButtonName="Create Cutter", ButtonStyle=0)
separator_3 = CreateSeparator(Thickness=0.5, Horizontal=True, Color=RGB(0, 0, 0))
button_4 = CreateButton(ButtonName="Save", ButtonStyle=0)
adjustpos = AdjustElementPositioning(
    ElementsToAdjust=button_4,
    Margin=Slider(20, range=0..100),
    AbsolutePositioning=False,
    Width=Slider(140, range=0..1000),
    Height=Slider(30, range=0..100))
adjustpos_2 = AdjustElementPositioning(
    ElementsToAdjust=button,
    Margin=Slider(20, range=0..100),
    AbsolutePositioning=False,
    Width=Slider(140, range=0..1000),
    Height=Slider(30, range=0..100))
values = ValueListener(Elements=button, SomeProperty=True)  # -> Values, Indices
values_2 = ValueListener(Elements=slider_2, SomeProperty=True)  # -> Values, Indices
values_3 = ValueListener(Elements=slider, SomeProperty=True)  # -> Values, Indices
values_4 = ValueListener(Elements=button_4, SomeProperty=True)  # -> Values, Indices
values_5 = ValueListener(Elements=button_3, SomeProperty=True)  # -> Values, Indices
merge = Merge(Data1=button_4, Data2=button)  # -> flatten(Result)
values_6 = ValueListener(Elements=button_2, SomeProperty=True)  # -> Values, Indices
cancel = Cancel(CancelButton=values.Values)
stack = CreateStack(UIElements=merge, Horizontal=Toggle(True))
tbvc_for_translational = TrueOnlyButtonValueController_Translational(TrueButtonValue=values_5.Values)
createcutter = CreateCutter(StartButton=tbvc_for_translational)
scale = ScaleCutter(Essentials=createcutter, ScaleFactor=values_3.Values, Thickness=values_2.Values)
saved = SavedItems()
radiobtn = CreateRadioButton(RadioButtonName="Slow", RadioButtonGroup="Gear Speed Group", InitiallySelected=False)
radiobtn_2 = CreateRadioButton(RadioButtonName="Normal", RadioButtonGroup="Gear Speed Group", InitiallySelected=Toggle(True))
radiobtn_3 = CreateRadioButton(RadioButtonName="Fast", RadioButtonGroup="Gear Speed Group", InitiallySelected=False)
values_7 = ValueListener(Elements=radiobtn_2, SomeProperty=True)  # -> Values, Indices
values_8 = ValueListener(Elements=radiobtn, SomeProperty=True)  # -> Values, Indices
values_9 = ValueListener(Elements=radiobtn_3, SomeProperty=True)  # -> Values, Indices
panel_2 = Panel(saved)
button_5 = CreateButton(ButtonName="Delete All", ButtonStyle=0)
merge_2 = Merge(Data1=radiobtn, Data2=radiobtn_2, Data3=radiobtn_3)  # -> flatten(Result)
radiolistener = RadioButtonListener(Slow=values_8.Values, Normal=values_7.Values, Fast=values_9.Values)
endeffector = ChooseEndEffector(Button=values_6.Values, Essentials=scale, GearSpeed=radiolistener)  # -> ResetButtonValue, SavedItem
save = Save(SaveButton=values_4.Values, Item=endeffector.SavedItem)
adjustpos_3 = AdjustElementPositioning(ElementsToAdjust=button_5, AbsolutePositioning=False, Width=Slider(75, range=0..100), Height=Slider(29, range=0..100))
listbox = CreateListBox(ListItems=flatten(panel_2), SelectedIndex=0, Height=100)
stack_2 = CreateStack(UIElements=merge_2, Horizontal=True)
merge_3 = Merge(
    Data1=tb_3,
    Data2=button_3,
    Data3=separator_3,
    Data4=tb,
    Data5=slider,
    Data6=slider_2,
    Data7=separator,
    Data8=tb_2,
    Data9=stack_2,
    Data10=button_2,
    Data11=separator_2,
    Data12=stack)
label = CreateLabel(LabelText="Saved Items", LabelSize=12, Justification=0)
values_10 = ValueListener(Elements=button_5, SomeProperty=True)  # -> Values, Indices
values_11 = ValueListener(Elements=listbox, SomeProperty=True)  # -> Values, Indices
merge_4 = Merge(Data1=label, Data2=listbox, Data3=button_5)  # -> flatten(Result)
panel_3 = Panel(values_10.Values)
deleteitem = DeleteItem(DeleteButton=values_10.Values, Item=values_11.Values)
panel_4 = Panel(values_11.Values)
viewbox = CreateViewBox(UIElements=merge_4, Width=Slider(80, range=0..1000), Height=Slider(200, range=0..1000))
separator_4 = CreateSeparator(Thickness=0.5, Horizontal=True, Color=RGB(0, 0, 0))
button_6 = CreateButton(ButtonName="Generate All", ButtonStyle=0)
button_7 = CreateButton(ButtonName="Cancel", ButtonStyle=0)
button_8 = CreateButton(ButtonName="Create model for 3D printer", ButtonStyle=0)
launchwin = LaunchWindow(
    Show=Toggle(True),
    Name="DynaModel",
    Width=Slider(380, range=0..1000),
    Height=400,
    ChildStatus=0,
    EnableHorizScroll=False)

# ---- group: Button
separator_5 = CreateSeparator(Thickness=0.5, Horizontal=True, Color=RGB(0, 0, 0))
button_9 = CreateButton(ButtonName="Save", ButtonStyle=0)
button_10 = CreateButton(ButtonName="Clear", ButtonStyle=0)
true_button = CreateTrueOnlyButton(ButtonName="Button", ButtonStyle=0)
tb_4 = CreateTextBlock(Text="Step 1: Press the button to create", TextSize=12, Justification=0)
adjustpos_4 = AdjustElementPositioning(
    ElementsToAdjust=true_button,
    Margin=Slider(20, range=0..100),
    AbsolutePositioning=False,
    Width=Slider(140, range=0..1000))
merge_5 = Merge(Data1=button_9, Data2=button_10)
button_11 = CreateButton(ButtonName="Create", ButtonStyle=0)
values_12 = ValueListener(Elements=true_button, SomeProperty=True)  # -> Values, Indices
stack_3 = CreateStack(UIElements=merge_5, Horizontal=True)
adjustpos_5 = AdjustElementPositioning(
    ElementsToAdjust=button_10,
    Margin=Slider(20, range=0..100),
    AbsolutePositioning=False,
    Width=Slider(140, range=0..1000),
    Height=Slider(30, range=0..100))
adjustpos_6 = AdjustElementPositioning(
    ElementsToAdjust=button_9,
    Margin=Slider(20, range=0..100),
    AbsolutePositioning=False,
    Width=Slider(140, range=0..1000),
    Height=Slider(30, range=0..100))
launchwin_2 = LaunchWindow(Show=values_12.Values, Name="Button", Width=370, Height=400, ChildStatus=0, EnableHorizScroll=False)
merge_6 = Merge(Data4=tb_4, Data5=button_11, Data6=separator_5, Data7=stack_3)
childwin = MakeChildWindow(ParentWindow=launchwin, ChildWindow=launchwin_2)
addelems = AddElements(Window=launchwin_2, Elements=flatten(merge_6), DoVLChecking=True)  # -> AddedElements, ElementNames

# ---- group: Touch
separator_6 = CreateSeparator(Thickness=0.5, Horizontal=True, Color=RGB(0, 0, 0))
button_12 = CreateButton(ButtonName="Save", ButtonStyle=0)
button_13 = CreateButton(ButtonName="Clear", ButtonStyle=0)
true_button_2 = CreateTrueOnlyButton(ButtonName="Touch", ButtonStyle=0)
tb_5 = CreateTextBlock(Text="Step 1: Press the button to create", TextSize=12, Justification=0)
adjustpos_7 = AdjustElementPositioning(
    ElementsToAdjust=true_button_2,
    Margin=Slider(20, range=0..100),
    AbsolutePositioning=False,
    Width=Slider(140, range=0..1000))
merge_7 = Merge(Data1=button_12, Data2=button_13)
button_14 = CreateButton(ButtonName="Create", ButtonStyle=0)
values_13 = ValueListener(Elements=true_button_2, SomeProperty=True)  # -> Values, Indices
stack_4 = CreateStack(UIElements=merge_7, Horizontal=True)
adjustpos_8 = AdjustElementPositioning(
    ElementsToAdjust=button_13,
    Margin=Slider(20, range=0..100),
    AbsolutePositioning=False,
    Width=Slider(140, range=0..1000),
    Height=Slider(30, range=0..100))
adjustpos_9 = AdjustElementPositioning(
    ElementsToAdjust=button_12,
    Margin=Slider(20, range=0..100),
    AbsolutePositioning=False,
    Width=Slider(140, range=0..1000),
    Height=Slider(30, range=0..100))
values_14 = ValueListener(Elements=button_14, SomeProperty=True)  # -> Values, Indices
values_15 = ValueListener(Elements=button_13, SomeProperty=True)  # -> Values, Indices
merge_8 = Merge(Data4=tb_5, Data5=button_14, Data6=separator_6, Data7=stack_4)
values_16 = ValueListener(Elements=button_12, SomeProperty=True)  # -> Values, Indices
launchwin_3 = LaunchWindow(Show=values_13.Values, Name="Touch", Width=370, Height=400, ChildStatus=0, EnableHorizScroll=False)
values_17 = ValueListener(Elements=button_11, SomeProperty=True)  # -> Values, Indices
values_18 = ValueListener(Elements=button_10, SomeProperty=True)  # -> Values, Indices
values_19 = ValueListener(Elements=button_9, SomeProperty=True)  # -> Values, Indices
cancel_2 = Cancel(CancelButton=values_15.Values)
createsimpletouch = CreateSimpleTouch(StartButton=values_14.Values)
childwin_2 = MakeChildWindow(ParentWindow=launchwin, ChildWindow=launchwin_3)
cancel_3 = Cancel(CancelButton=values_18.Values)
save_2 = Save(SaveButton=values_16.Values, Item=createsimpletouch)
addelems_2 = AddElements(Window=launchwin_3, Elements=flatten(merge_8), DoVLChecking=True)  # -> AddedElements, ElementNames
createsimplebutton = CreateSimpleButton(StartButton=values_17.Values)
save_3 = Save(SaveButton=values_19.Values, Item=createsimplebutton)

# ---- group: Air Pipe
panel_5 = Panel("Step 1: Press the button to create a air pipe to detect humidity and temperature")
separator_7 = CreateSeparator(Thickness=0.5, Horizontal=True, Color=RGB(0, 0, 0))
true_button_3 = CreateTrueOnlyButton(ButtonName="Air Pipe", ButtonStyle=0)
button_15 = CreateButton(ButtonName="Save", ButtonStyle=0)
button_16 = CreateButton(ButtonName="Clear", ButtonStyle=0)
adjustpos_10 = AdjustElementPositioning(
    ElementsToAdjust=true_button_3,
    Margin=Slider(20, range=0..100),
    AbsolutePositioning=False,
    Width=Slider(140, range=0..1000))
button_17 = CreateButton(ButtonName="Create", ButtonStyle=0)
tb_6 = CreateTextBlock(Text=panel_5, TextSize=12, Justification=0)
values_20 = ValueListener(Elements=true_button_3, SomeProperty=True)  # -> Values, Indices
merge_9 = Merge(Data1=button_15, Data2=button_16)
launchwin_4 = LaunchWindow(Show=values_20.Values, Name="Air Pipe", Width=370, Height=400, ChildStatus=0, EnableHorizScroll=False)
values_21 = ValueListener(Elements=button_17, SomeProperty=True)  # -> Values, Indices
stack_5 = CreateStack(UIElements=merge_9, Horizontal=True)
adjustpos_11 = AdjustElementPositioning(
    ElementsToAdjust=button_16,
    Margin=Slider(20, range=0..100),
    AbsolutePositioning=False,
    Width=Slider(140, range=0..1000),
    Height=Slider(30, range=0..100))
adjustpos_12 = AdjustElementPositioning(
    ElementsToAdjust=button_15,
    Margin=Slider(20, range=0..100),
    AbsolutePositioning=False,
    Width=Slider(140, range=0..1000),
    Height=Slider(30, range=0..100))
createsimplepipe = CreateSimplePipe(StartButton=values_21.Values, InputType="NA", OutputType="Air Pipe")
values_22 = ValueListener(Elements=button_16, SomeProperty=True)  # -> Values, Indices
values_23 = ValueListener(Elements=button_15, SomeProperty=True)  # -> Values, Indices
childwin_3 = MakeChildWindow(ParentWindow=launchwin, ChildWindow=launchwin_4)
merge_10 = Merge(Data1=tb_6, Data2=button_17, Data3=separator_7, Data4=stack_5)
addelems_3 = AddElements(Window=launchwin_4, Elements=flatten(merge_10), DoVLChecking=True)  # -> AddedElements, ElementNames
save_4 = Save(SaveButton=values_23.Values, Item=createsimplepipe)
cancel_4 = Cancel(CancelButton=values_22.Values)

# ---- group: Light
pipe_radius_mm = Slider(3, range=1..6)
true_button_4 = CreateTrueOnlyButton(ButtonName="LED Light", ButtonStyle=0)
adjustpos_13 = AdjustElementPositioning(
    ElementsToAdjust=true_button_4,
    Margin=Slider(20, range=0..100),
    AbsolutePositioning=False,
    Width=Slider(140, range=0..1000))
values_24 = ValueListener(Elements=true_button_4, SomeProperty=True)  # -> Values, Indices
separator_8 = CreateSeparator(Thickness=0.5, Horizontal=True, Color=RGB(0, 0, 0))
separator_9 = CreateSeparator(Thickness=0.5, Horizontal=True, Color=RGB(0, 0, 0))
button_18 = CreateButton(ButtonName="Create", ButtonStyle=0)
tb_7 = CreateTextBlock(Text="Step 2: Design the light outsource and create", TextSize=12, Justification=0)
button_19 = CreateButton(ButtonName="Clear", ButtonStyle=0)
button_20 = CreateButton(ButtonName="Save", ButtonStyle=0)
slider_3 = CreateSlider(Slider=pipe_radius_mm, ShowBounds=False, ShowTicks=False, ShowTooltip=False, ShowValLabel=True, showLabel=True)
adjustpos_14 = AdjustElementPositioning(
    ElementsToAdjust=button_19,
    Margin=Slider(20, range=0..100),
    AbsolutePositioning=False,
    Width=Slider(140, range=0..1000),
    Height=Slider(30, range=0..100))
adjustpos_15 = AdjustElementPositioning(
    ElementsToAdjust=button_20,
    Margin=Slider(20, range=0..100),
    AbsolutePositioning=False,
    Width=Slider(140, range=0..1000),
    Height=Slider(30, range=0..100))
tb_8 = CreateTextBlock(Text="Step 1: Decide the light pipe's parameters", TextSize=12, Justification=0)
launchwin_5 = LaunchWindow(Show=values_24.Values, Name="LED Light", Width=370, Height=400, ChildStatus=0, EnableHorizScroll=False)
values_25 = ValueListener(Elements=button_18, SomeProperty=True)  # -> Values, Indices
values_26 = ValueListener(Elements=button_20, SomeProperty=True)  # -> Values, Indices
values_27 = ValueListener(Elements=button_19, SomeProperty=True)  # -> Values, Indices
merge_11 = Merge(Data1=button_20, Data2=button_19)  # -> flatten(Result)
childwin_4 = MakeChildWindow(ParentWindow=launchwin, ChildWindow=launchwin_5)
createpipe = CreatePipe(StartButton=values_25.Values, InputType="NA", OutputType="LED Light")
cancel_5 = Cancel(CancelButton=values_27.Values)
save_5 = Save(SaveButton=values_26.Values, Item=createpipe)
stack_6 = CreateStack(UIElements=merge_11, Horizontal=True)
merge_12 = Merge(Data1=tb_8, Data2=slider_3, Data4=separator_9, Data5=tb_7, Data6=button_18, Data7=separator_8, Data8=stack_6)
addelems_4 = AddElements(Window=launchwin_5, Elements=flatten(merge_12), DoVLChecking=True)  # -> AddedElements, ElementNames

# ---- group: Rotational
true_button_5 = CreateTrueOnlyButton(ButtonName="Rotational Motion", ButtonStyle=0)
adjustpos_16 = AdjustElementPositioning(
    ElementsToAdjust=true_button_5,
    Margin=Slider(20, range=0..100),
    AbsolutePositioning=False,
    Width=Slider(140, range=0..1000))
values_28 = ValueListener(Elements=true_button_5, SomeProperty=True)  # -> Values, Indices
launchwin_6 = LaunchWindow(Show=values_28.Values, Name="Rotational Motion", Width=370, Height=400, ChildStatus=0, EnableHorizScroll=False)
childwin_5 = MakeChildWindow(ParentWindow=launchwin, ChildWindow=launchwin_6)
thickness_2 = Slider(1, range=0.005..2)
size_2 = Slider(1, range=0.005..2)
panel_6 = Panel("Step 1: Create a cutter to cut the model into two part: main model and end effector")
separator_10 = CreateSeparator(Thickness=0.5, Horizontal=True, Color=RGB(0, 0, 0))
tb_9 = CreateTextBlock(Text="Step 2: Scale the cutter", TextSize=12, Justification=0)
slider_4 = CreateSlider(Slider=size_2, ShowBounds=False, ShowTicks=False, ShowTooltip=False, ShowValLabel=True, showLabel=True)
slider_5 = CreateSlider(Slider=thickness_2, ShowBounds=False, ShowTicks=False, ShowTooltip=False, ShowValLabel=True, showLabel=True)
button_21 = CreateButton(ButtonName="Clear", ButtonStyle=0)
separator_11 = CreateSeparator(Thickness=0.5, Horizontal=True, Color=RGB(0, 0, 0))
button_22 = CreateButton(ButtonName="Choose", ButtonStyle=0)
tb_10 = CreateTextBlock(Text="Step 3: Choose your end effector", TextSize=12, Justification=0)
tb_11 = CreateTextBlock(Text=panel_6, TextSize=12, Justification=0)
button_23 = CreateButton(ButtonName="Create Cutter", ButtonStyle=0)
separator_12 = CreateSeparator(Thickness=0.5, Horizontal=True, Color=RGB(0, 0, 0))
button_24 = CreateButton(ButtonName="Save", ButtonStyle=0)
adjustpos_17 = AdjustElementPositioning(
    ElementsToAdjust=button_24,
    Margin=Slider(20, range=0..100),
    AbsolutePositioning=False,
    Width=Slider(140, range=0..1000),
    Height=Slider(30, range=0..100))
adjustpos_18 = AdjustElementPositioning(
    ElementsToAdjust=button_21,
    Margin=Slider(20, range=0..100),
    AbsolutePositioning=False,
    Width=Slider(140, range=0..1000),
    Height=Slider(30, range=0..100))
values_29 = ValueListener(Elements=button_21, SomeProperty=True)  # -> Values, Indices
values_30 = ValueListener(Elements=slider_5, SomeProperty=True)  # -> Values, Indices
values_31 = ValueListener(Elements=slider_4, SomeProperty=True)  # -> Values, Indices
values_32 = ValueListener(Elements=button_24, SomeProperty=True)  # -> Values, Indices
values_33 = ValueListener(Elements=button_23, SomeProperty=True)  # -> Values, Indices
merge_13 = Merge(Data1=button_24, Data2=button_21)  # -> flatten(Result)
values_34 = ValueListener(Elements=button_22, SomeProperty=True)  # -> Values, Indices
tbvc = TrueButtonValueController(TrueButtonValue=values_33.Values)
cancel_6 = Cancel(CancelButton=values_29.Values)
stack_7 = CreateStack(UIElements=merge_13, Horizontal=Toggle(True))
cutter = CreateCutter(StartButton=tbvc)
scale_2 = ScaleCutter(Essentials=cutter, ScaleFactor=values_31.Values, Thickness=values_30.Values)
radiobtn_4 = CreateRadioButton(RadioButtonName="Slow", RadioButtonGroup="Gear Speed Group", InitiallySelected=False)
radiobtn_5 = CreateRadioButton(RadioButtonName="Normal", RadioButtonGroup="Gear Speed Group", InitiallySelected=Toggle(True))
radiobtn_6 = CreateRadioButton(RadioButtonName="Fast", RadioButtonGroup="Gear Speed Group", InitiallySelected=False)
values_35 = ValueListener(Elements=radiobtn_5, SomeProperty=True)  # -> Values, Indices
values_36 = ValueListener(Elements=radiobtn_4, SomeProperty=True)  # -> Values, Indices
values_37 = ValueListener(Elements=radiobtn_6, SomeProperty=True)  # -> Values, Indices
radiolistener_2 = RadioButtonListener(Slow=values_36.Values, Normal=values_35.Values, Fast=values_37.Values)
endeffector_2 = ChooseEndEffector(Button=values_34.Values, Essentials=scale_2, GearSpeed=radiolistener_2)  # -> ResetButtonValue, SavedItem
save_6 = Save(SaveButton=values_32.Values, Item=endeffector_2.SavedItem)
merge_14 = Merge(Data1=radiobtn_4, Data2=radiobtn_5, Data3=radiobtn_6)  # -> flatten(Result)
stack_8 = CreateStack(UIElements=merge_14, Horizontal=True)
merge_15 = Merge(
    Data1=tb_11,
    Data2=button_23,
    Data3=separator_12,
    Data4=tb_9,
    Data5=slider_4,
    Data6=slider_5,
    Data7=separator_10,
    Data8=tb_10,
    Data9=stack_8,
    Data10=button_22,
    Data11=separator_11,
    Data12=stack_7)
addelems_5 = AddElements(Window=launchwin_6, Elements=flatten(merge_15), DoVLChecking=True)  # -> AddedElements, ElementNames

# ----
merge_16 = Merge(Data2=true_button_2)  # -> flatten(Result)
merge_17 = Merge(Data1=true_button, Data2=true_button_2)  # -> flatten(Result)
stack_9 = CreateStack(UIElements=merge_16, Horizontal=Toggle(True))
stack_10 = CreateStack(UIElements=merge_17, Horizontal=Toggle(True))
merge_18 = Merge(Data1=true_button_4, Data2=true_button_3)  # -> flatten(Result)
stack_11 = CreateStack(UIElements=merge_18, Horizontal=Toggle(True))
merge_19 = Merge(Data1=button_6, Data2=button_7)
stack_12 = CreateStack(UIElements=merge_19, Horizontal=True)
adjustpos_19 = AdjustElementPositioning(
    ElementsToAdjust=button_7,
    Margin=Slider(20, range=0..100),
    AbsolutePositioning=False,
    Width=Slider(140, range=0..1000),
    Height=Slider(30, range=0..100))
adjustpos_20 = AdjustElementPositioning(
    ElementsToAdjust=button_6,
    Margin=Slider(20, range=0..100),
    AbsolutePositioning=False,
    Width=Slider(140, range=0..1000),
    Height=Slider(30, range=0..100))
separator_13 = CreateSeparator(Thickness=0.5, Horizontal=True, Color=RGB(0, 0, 0))
values_38 = ValueListener(Elements=button_6, SomeProperty=True)  # -> Values, Indices
nickname = Generate(GenerateButton=values_38.Values)

# ---- group: Transitional Motion
panel_7 = Panel("Transitional Motion")

# ----
true_button_6 = CreateTrueOnlyButton(ButtonName=panel_7, ButtonStyle=0)

# ---- group: Transitional Motion (continued)
adjustpos_21 = AdjustElementPositioning(
    ElementsToAdjust=true_button_6,
    Margin=Slider(20, range=0..100),
    AbsolutePositioning=False,
    Width=Slider(140, range=0..200))

# ----
values_39 = ValueListener(Elements=true_button_6, SomeProperty=True)  # -> Values, Indices
launchwin_7 = LaunchWindow(Show=values_39.Values, Name="Transitional Motion", Width=370, Height=400, ChildStatus=0, EnableHorizScroll=False)
childwin_6 = MakeChildWindow(ParentWindow=launchwin, ChildWindow=launchwin_7)
addelems_6 = AddElements(Window=launchwin_7, Elements=flatten(merge_3), DoVLChecking=True)  # -> AddedElements, ElementNames
merge_20 = Merge(Data1=true_button_5, Data2=true_button_6)  # -> flatten(Result)
stack_13 = CreateStack(UIElements=merge_20, Horizontal=Toggle(True))
merge_21 = Merge(Data1=stack_13, Data2=stack_11, Data3=stack_9, Data4=stack_10)  # -> flatten(Result)
viewbox_2 = CreateViewBox(UIElements=merge_21, Width=Slider(279, range=0..1000), Height=Slider(292, range=0..1000))
merge_22 = Merge(Data1=viewbox, Data2=viewbox_2)  # -> flatten(Result)
stack_14 = CreateStack(UIElements=merge_22, Horizontal=True)
merge_23 = Merge(Data1=stack_14, Data2=separator_13, Data3=stack_12, Data4=separator_4, Data5=button_8)
addelems_7 = AddElements(Window=launchwin, Elements=flatten(merge_23), DoVLChecking=True)  # -> AddedElements, ElementNames
